# Grasshopper definition Final_mindfield.gh (Grasshopper 1.0.7)
# plug-ins: Exoskeleton2, Topologizer, Weaverbird

# ---- group: Head Mesh from Turbosquid
mesh = Mesh(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)

# ---- group: Find Center Point of Head
bounding_box = BoundingBox(Content=mesh, Plane=PlaneXY(0, 0, 0))  # -> Box, Box_2
volume = Volume(Geometry=bounding_box.Box)  # -> Volume, Centroid

# ----
custom_preview = CustomPreview(Geometry=mesh, Shader=ColourSwatch(SwatchColor=RGB(102, 62, 117)))

# ---- group: Find Radius of Head
deconstruct_box = DeconstructBox(Box=bounding_box.Box)  # -> Plane, X, Y, Z
number = Number(expr("x/2", deconstruct_box.X))

# ---- group: Move Center Point if Needed
setback_from_center = Slider(0.99, range=-10..10)
vector_xyz = VectorXYZ(XComponent=0, YComponent=setback_from_center, ZComponent=0)  # -> Vector, Length
move = Move(Geometry=volume.Centroid, Motion=vector_xyz.Vector)  # -> Geometry, Transform

# ---- group: Shrink radius a bit
circle_scaling_factor = Slider(0.67, range=0..1)

# ----
multiplication = Multiplication(A=number, B=circle_scaling_factor)

# ---- group: Draw Circle at Center of Head, Scale if Needed, and Divide it Up into Evenly Spaced Points
circle_cnr = CircleCNR(Center=move.Geometry, Normal=Vector(0, 0, 1), Radius=multiplication)
scale_nu = ScaleNU(Geometry=circle_cnr, Plane=move.Geometry, ScaleX=Slider(1.25, range=0..2), ScaleY=Slider(1.49, range=0..2), ScaleZ=1)  # -> Geometry, Transform
divide_curve = DivideCurve(Curve=scale_nu.Geometry, Count=16, Kinks=False)  # -> Points, Tangents, Parameters

# ---- group: Get Leftmost and Rightmost Points on Ears
deconstruct_mesh = DeconstructMesh(Mesh=mesh)  # -> Vertices, Faces, Colours, Normals
sort_points = SortPoints(Points=deconstruct_mesh.Vertices)  # -> Points, Indices
list_item = ListItem(List=sort_points.Points, Index=-1, Wrap=True)
list_item_2 = ListItem(List=sort_points.Points, Index=0, Wrap=True)

# ----
inner_point_indentation_bias = Slider(0, range=0..10)

# ---- group: Make Points Accross Head Midline
list_item_3 = ListItem(List=divide_curve.Points, Index=0, Wrap=True)
list_item_4 = ListItem(List=divide_curve.Points, Index=8, Wrap=True)
line = Line(StartPoint=list_item_3, EndPoint=list_item_4)
divide_curve_2 = DivideCurve(Curve=line, Count=4, Kinks=False)  # -> Points, Tangents, Parameters
panel = Panel("""0
-1""")
cull_index = CullIndex(List=divide_curve_2.Points, Indices=panel, Wrap=True)  # -> flatten(List)

# ----
number_slider = Slider(2, range=0..10)

# ---- group: Move Ear Points Back to Temples
temple_setback_amount = Slider(0.58, range=0..10)
vector_xyz_2 = VectorXYZ(XComponent=expr("-x", temple_setback_amount), YComponent=temple_setback_amount, ZComponent=number_slider)  # -> Vector, Length
vector_xyz_3 = VectorXYZ(XComponent=temple_setback_amount, YComponent=temple_setback_amount, ZComponent=number_slider)  # -> Vector, Length
move_2 = Move(Geometry=list_item_2, Motion=vector_xyz_3.Vector)  # -> Geometry, Transform
move_3 = Move(Geometry=list_item, Motion=vector_xyz_2.Vector)  # -> Geometry, Transform

# ---- group: Draw 2 Inner Back Points
unit_y = UnitY(Factor=inner_point_indentation_bias)
list_item_5 = ListItem(List=divide_curve.Points, Index=6, Wrap=True)
list_item_6 = ListItem(List=divide_curve.Points, Index=2, Wrap=True)
negative = Negative(Value=unit_y)
bezier_span = BezierSpan(StartPoint=list_item_6, StartTangent=negative, EndPoint=list_item_5, EndTangent=negative)  # -> Curve, Length, Domain
divide_curve_3 = DivideCurve(Curve=bezier_span.Curve, Count=4, Kinks=False)  # -> Points, Tangents, Parameters
panel_2 = Panel("""0
-1""")
cull_index_2 = CullIndex(List=divide_curve_3.Points, Indices=panel_2, Wrap=True)  # -> flatten(List)

# ---- group: Draw 3 Inner Front Points
list_item_7 = ListItem(List=divide_curve.Points, Index=10, Wrap=True)
unit_y_2 = UnitY(Factor=inner_point_indentation_bias)
list_item_8 = ListItem(List=divide_curve.Points, Index=14, Wrap=True)
bezier_span_2 = BezierSpan(StartPoint=list_item_7, StartTangent=unit_y_2, EndPoint=list_item_8, EndTangent=unit_y_2)  # -> Curve, Length, Domain
divide_curve_4 = DivideCurve(Curve=bezier_span_2.Curve, Count=4, Kinks=False)  # -> Points, Tangents, Parameters
panel_3 = Panel("""0
-1""")
cull_index_3 = CullIndex(List=divide_curve_4.Points, Indices=panel_3, Wrap=True)  # -> flatten(List)

# ---- group: Main Ring of Points
panel_4 = Panel("""1
7
9	
15""")
cull_index_4 = CullIndex(List=divide_curve.Points, Indices=panel_4, Wrap=True)  # -> flatten(List)

# ----
circle = Circle(Plane=cull_index_4, Radius=Slider(0.2, range=0..1))
circle_2 = Circle(Plane=cull_index, Radius=Slider(0.2, range=0..1))
point_charge = PointCharge(Point=circle, Charge=Slider(1, range=-10..10), Decay=2)

# ---- group: Find Points on Mesh Closest to Temple Points
mesh_closest_point = MeshClosestPoint(Point=[move_3.Geometry, move_2.Geometry], Mesh=mesh)  # -> Point, Index, Parameter

# ----
circle_3 = Circle(Plane=cull_index_3, Radius=Slider(0.2, range=0..1))
circle_4 = Circle(Plane=cull_index_2, Radius=Slider(0.2, range=0..1))
point_charge_2 = PointCharge(Point=circle_2, Charge=Slider(0.524, range=-10..10), Decay=2)
divide_curve_5 = DivideCurve(Curve=circle, Count=Slider(4, range=0..10), Kinks=False)  # -> flatten(Points), Tangents, Parameters
point_charge_3 = PointCharge(Point=circle_4, Charge=Slider(-3.427, range=-10..10), Decay=2)
spin_force = SpinForce(Plane=circle_3, Strength=Slider(-10, range=-10..10), Radius=Slider(0.2, range=0..1), Decay=2)
point_charge_4 = PointCharge(Point=mesh_closest_point.Point, Charge=Slider(-8, range=-10..10), Decay=2)
merge_fields = MergeFields(Fields=[point_charge_2, point_charge_3, spin_force])
field_line = FieldLine(
    Field=flatten(merge_fields),
    Point=flatten(divide_curve_5.Points),
    Steps=Slider(692, range=0..1000),
    Accuracy=0.1,
    Method=3)
scalar_display = ScalarDisplay(Field=merge_fields, Section=scale_nu.Geometry, Samples=1000)  # disabled
discontinuity = Discontinuity(Curve=field_line, Level=1)  # -> Points, Parameters

# ---- group: Collect Points
point = Point(flatten([cull_index_4, cull_index, cull_index_3, cull_index_2, mesh_closest_point.Point]))

# ----
unit_z = UnitZ(Factor=1)
project_point = ProjectPoint(Point=discontinuity.Points, Direction=unit_z, Geometry=mesh)  # -> Point, Index
clean_tree = CleanTree(RemoveNulls=True, RemoveInvalid=True, RemoveEmpty=True, Tree=project_point.Point)
circle_5 = Circle(Plane=clean_tree, Radius=Slider(0.363, range=0..1))  # -> flatten(Circle)

# ---- group: Make Distance-Based Connections
proximity_3d = Proximity3D(Points=flatten(circle_5), Group=Slider(10, range=0..10))  # -> Links, Topology

# ---- group: Make Tri Interconnections
delaunay_edges = DelaunayEdges(Points=flatten(circle_5), Plane=PlaneXY(0, 0, 0))  # -> Connectivity, Edges

# ---- group: Remove Close Points
topologizer = Topologizer(LinesInput=delaunay_edges.Edges, Tolerance=Slider(0.7, range=0..1))  # -> Lines, Points, LineStart, LineStart_2, Neighbours, Incoming, Outgoing, Graph

# ----
exowireframe = ExoWireframe(
    Lines=topologizer.Lines,
    Sides=6,
    StartRadius=Slider(0.02, range=0..0.1),
    EndRadius=Slider(0.02, range=0..0.1),
    NodeDepth=0,
    Division=Slider(6, range=0..10),
    Open=False)
weaverbird_s_catmull_clark_subdivision = WeaverbirdsCatmullClarkSubdivision(MeshCurves=exowireframe, Level=Slider(3, range=0..10), SmoothNakedEdges=1)
